# Grasshopper definition example.ghx (Grasshopper 1.0.8)
# plug-ins: RhinoCodePluginGH, Speckle 2, LunchBox

panel = Panel("https://macad.speckle.xyz/projects/a932e194ee/models/5001ef0d3c")

# ---- group: RH_IN:Send
txt = Text()

# ----
synchronous_receiver = SynchronousReceiver(
    Stream=panel,
    AutoReceive=False,
    ReceivedObjectId="c65b70b2e3b20c6164538c66aa3cb4d2",
    StreamWrapper="https://macad.speckle.xyz/projects/a932e194ee/models/5001ef0d3c",
    selectedKitName="Objects")  # -> Data, Info
sovk = SpeckleObjectValueByKey(Object=synchronous_receiver.Data, Key="elements", selectedKitName="Objects")
sovk_2 = SpeckleObjectValueByKey(Object=sovk, Key="elements", selectedKitName="Objects")
sovk_3 = SpeckleObjectValueByKey(Object=sovk_2, Key="parameters", selectedKitName="Objects")

sovk_4 = SpeckleObjectValueByKey(Object=sovk_3, Key="faae278b-7fcd-4840-9d5c-fcd1cb2c4068", selectedKitName="Objects")
sovk_5 = SpeckleObjectValueByKey(Object=sovk_4, Key="name", selectedKitName="Objects")
sovk_6 = SpeckleObjectValueByKey(Object=sovk_4, Key="value", selectedKitName="Objects")
panel_2 = Panel(sovk_5)
panel_3 = Panel(sovk_6)

sovk_7 = SpeckleObjectValueByKey(Object=sovk_3, Key="87c493a7-09c4-42fb-8bfb-c683efe1bbf7", selectedKitName="Objects")
sovk_8 = SpeckleObjectValueByKey(Object=sovk_7, Key="name", selectedKitName="Objects")
sovk_9 = SpeckleObjectValueByKey(Object=sovk_7, Key="value", selectedKitName="Objects")
panel_4 = Panel(sovk_9)
panel_5 = Panel(sovk_8)

sovk_10 = SpeckleObjectValueByKey(Object=sovk_2, Key="displayValue", selectedKitName="Objects")
panel_6 = Panel(sovk_10)
mesh_join = MeshJoin(Meshes=sovk_10)
bbox = BoundingBox(Content=sovk_10, Plane=PlaneXY(0, 0, 0))  # -> Box, Box_2
python_3_script = Python3Script(x=mesh_join)  # -> out, a
# ---------- python_3_script: Python ----------
import Rhino
import scriptcontext as sc
import rhinoscriptsyntax as rs

def mesh_to_brep(mesh):
    mesh_obj = rs.coercemesh(mesh)  # Convert GUID to mesh object
    if mesh_obj:
        brep = Rhino.Geometry.Brep.CreateFromMesh(mesh_obj, True)  # Convert to Brep
        if brep:
            sc.doc.Objects.AddBrep(brep)  # Add to Rhino document
            return brep
    return None

# Grasshopper Input
mesh = x  # Mesh input (GUID)

# Convert to Brep
brep = mesh_to_brep(mesh)

# Grasshopper Output
a = brep
# ---------- end python_3_script ----------
deconstruct_brep = DeconstructBrep(Brep=python_3_script.a)  # -> Faces, Edges, Vertices
debrep = DeconstructBrep(Brep=bbox.Box_2)  # -> flatten(Faces), Edges, Vertices
list_item = ListItem(List=deconstruct_brep.Faces, Index=[Slider(2, range=0..10), Slider(3, range=0..10)], Wrap=True)
random_quad_panels = RandomQuadPanels(Surface=list_item, UDivisions=panel_3, VDivisions=panel_4, RandomSeed=10)
trib = TrianglePanelsB(Surface=list_item, UDivisions=Slider(5, range=0..10), VDivisions=Slider(5, range=0..10))
area = Area(Geometry=random_quad_panels)  # -> Area, Centroid
area_2 = Area(Geometry=list_item)  # -> Area, Centroid
scale = Scale(Geometry=random_quad_panels, Center=area.Centroid, Factor=Slider(0.9, range=0..1))  # -> Geometry, Transform
lng = ListLength(List=scale.Geometry)
change_project_for_streams = Panel("https://macad.speckle.xyz/projects/011d53483d")

sgetwt = StreamGetWithToken(Stream=change_project_for_streams, AuthToken="0a7a2c01a136ad89e2cfa5e002c9f1bcbe5656a1d0")

panel_8 = Panel("Receive_From_Compute Stream")
random = Random(Range="0 to 100", Number=lng, Seed=2)
panel_9 = Panel("Bot Speckle Token")

# ---- group: RH_IN:Receive
txt_2 = Text()

# ----
cso = CreateSpeckleObject(Panels=scale.Geometry, Fake_Cost=random, selectedKitName="Objects")

# ---- group: RH_OUT:Cost
num = Number(random)

# ----
panel_10 = Panel(num)
ss = SynchronousSender(Data=cso, Stream=sgetwt, UseDefaultCache=True, selectedKitName="Objects")
